# Grasshopper definition Bridge_001.gh (Grasshopper 1.0.7)
# plug-ins: Hops

number_slider = Slider(22, range=0..100)  # disabled
number_slider_2 = Slider(21, range=0..100)  # disabled
number_slider_3 = Slider(34, range=0..100)  # disabled
number_slider_4 = Slider(1.9, range=1.5..2)  # disabled
number_slider_5 = Slider(20, range=0..100)
panel = Panel("2")  # disabled
pi = Pi(Factor=number_slider_4)  # disabled
pi_2 = Pi(Factor=Slider(1.86, range=1.5..2))
drawbridge_15 = Hops(
    Length=number_slider,
    Width=number_slider_2,
    Height=number_slider_3,
    Degree=panel,
    Angle=pi,
    DoorHeight=number_slider,
    CacheResultsInMemory=False,
    CacheSolveResults=False,
    RemoteDefinitionLocation="http://127.0.0.1:5000/drawbridge_15",
    RemoteSolveVersion=(0, 1, 0),
    ShowInput_Enabled=False,
    ShowInput_Path=False,
    SynchronousSolve=True)  # -> Base, Top, Door; disabled
# Creating a Bridge with Copilot AI
# into Grasshopper for Rhino3D
# at www.wickersonstudios.com
# Bridge
# Instructions:
# 1. Drag and drop a hops node on the canvas.
# 2. Set path to:
# http://127.0.0.1:5000/drawbridge_04
# 3. Name and toggle  component name to :
# drawbridge_04
# drawbridge_04
drawbridge_04 = Hops(
    Length=number_slider,
    Width=number_slider_2,
    Height=number_slider_3,
    CacheResultsInMemory=True,
    CacheSolveResults=True,
    RemoteDefinitionLocation="http://127.0.0.1:5000/drawbridge_04",
    RemoteSolveVersion=(0, 1, 0),
    ShowInput_Enabled=False,
    ShowInput_Path=False,
    SynchronousSolve=True)  # disabled
drawbridge_07 = Hops(
    Length=number_slider,
    Width=number_slider_2,
    Height=number_slider_3,
    Degree=panel,
    CacheResultsInMemory=False,
    CacheSolveResults=False,
    RemoteDefinitionLocation="http://127.0.0.1:5000/drawbridge_07",
    RemoteSolveVersion=(0, 1, 0),
    ShowInput_Enabled=False,
    ShowInput_Path=False,
    SynchronousSolve=True)  # -> Base, Top; disabled
drawbridge_10 = Hops(
    Length=number_slider,
    Width=number_slider_2,
    Height=number_slider_3,
    Degree=panel,
    Angle=pi,
    CacheResultsInMemory=True,
    CacheSolveResults=True,
    RemoteDefinitionLocation="http://127.0.0.1:5000/drawbridge_10",
    RemoteSolveVersion=(0, 1, 0),
    ShowInput_Enabled=False,
    ShowInput_Path=False,
    SynchronousSolve=True)  # -> Base, Top; disabled
drawbridge_15_2 = Hops(
    Length=number_slider_5,
    Width=Slider(19, range=0..100),
    Height=Slider(0, range=0..100),
    Degree="2",
    Angle=pi_2,
    DoorHeight=number_slider_5,
    CacheResultsInMemory=False,
    CacheSolveResults=False,
    RemoteDefinitionLocation="http://127.0.0.1:5000/drawbridge_15",
    RemoteSolveVersion=(0, 1, 0),
    ShowInput_Enabled=False,
    ShowInput_Path=False,
    SynchronousSolve=True)  # -> Base, Top, Door
curve = Curve(drawbridge_04)  # disabled
curve_2 = Curve(drawbridge_10.Base)  # disabled
curve_3 = Curve(drawbridge_07.Base)  # disabled
curve_4 = Curve(drawbridge_07.Top)  # disabled
curve_5 = Curve(drawbridge_10.Top)  # disabled
curve_6 = Curve(drawbridge_15.Top)  # disabled
curve_7 = Curve(drawbridge_15.Door)  # disabled
curve_8 = Curve(drawbridge_15.Base)  # disabled
curve_9 = Curve(drawbridge_15_2.Top)
curve_10 = Curve(drawbridge_15_2.Door)
curve_11 = Curve(drawbridge_15_2.Base)
divide_curve = DivideCurve(Curve=curve_9, Count=expr("x+1", "2"), Kinks=False)  # -> Points, Tangents, Parameters
divide_curve_2 = DivideCurve(Curve=curve_10, Count=expr("x+1", "2"), Kinks=False)  # -> Points, Tangents, Parameters
panel_2 = Panel(curve)  # disabled
panel_3 = Panel(curve_3)  # disabled
panel_4 = Panel(curve_4)  # disabled
panel_5 = Panel(curve_2)  # disabled
panel_6 = Panel(curve_5)  # disabled
panel_7 = Panel(curve_6)  # disabled
panel_8 = Panel(curve_8)  # disabled
panel_9 = Panel(curve_7)  # disabled
number_slider_6 = Slider(21.82, range=0..100)
list_item = ListItem(List=divide_curve.Points, Index=0, Wrap=True)  # -> Item, Item1, Item2, Item3
list_item_2 = ListItem(List=divide_curve_2.Points, Index=0, Wrap=True)  # -> Item, Item1, Item2, Item3
line = Line(StartPoint=list_item_2.Item, EndPoint=list_item_2.Item3)
join_curves = JoinCurves(Curves=flatten([line, curve_10]), Preserve=False)
join_curves_2 = JoinCurves(Curves=[curve_9, line], Preserve=False)
join_curves_3 = JoinCurves(Curves=[line, curve_11], Preserve=False)
construct_point = ConstructPoint(XCoordinate=".5", YCoordinate=".5", ZCoordinate=0)
boundary_surfaces = BoundarySurfaces(Edges=join_curves_2)
offset_curve = OffsetCurve(Curve=join_curves, Distance=1, Corners=1)
evaluate_surface = EvaluateSurface(Surface=reparameterize(boundary_surfaces), Point=construct_point)  # -> Point, Normal, UDirection, VDirection, Frame
unit_z = UnitZ(Factor=1)
boundary_surfaces_2 = BoundarySurfaces(Edges=flatten([join_curves, offset_curve]))
unit_x = UnitX(Factor=1)
boundary_surfaces_3 = BoundarySurfaces(Edges=join_curves_3)
negative = Negative(Value=evaluate_surface.Normal)
extrude = Extrude(Base=boundary_surfaces_3, Direction=expr("x*(-1)", unit_z))
catenary = Catenary(PointA=list_item.Item1, PointB=list_item_2.Item1, Length=number_slider_6, Gravity=Vector(0, 0, -1))
catenary_2 = Catenary(PointA=list_item.Item2, PointB=list_item_2.Item2, Length=number_slider_6, Gravity=Vector(0, 0, -1))
move = Move(Geometry=extrude, Motion=expr("x*(-1)", unit_z))  # -> Geometry, Transform
extrude_2 = Extrude(Base=boundary_surfaces_2, Direction=expr("-x", unit_x))
extrude_3 = Extrude(Base=boundary_surfaces, Direction=negative)
