# Grasshopper definition gpt_4_Bridge_002.gh (Grasshopper 1.0.7)
# plug-ins: Bifocals

# GPT-4 and the GhPython Node at
# www.wickersonstudios.com
number_slider = Slider(55.7, range=0..100)
create_cylinder_bridge = GhPythonScript(
    length=Slider(100, range=0..100),
    width=Slider(11.21, range=0..100),
    height=Slider(20, range=0..100),
    divisions=Slider(10, range=0..10),
    pillar_radius=Slider(1.91, range=0..100),
    beam_radius=Slider(1.1, range=0..100))  # -> out, a; inputs divisions: Int32
# ---------- create_cylinder_bridge: Python ----------
import Rhino
import math
import scriptcontext
import rhinoscriptsyntax as rs

def create_cylinder_bridge(length, width, height, divisions, pillar_radius, beam_radius):
    # Calculate division length
    div_length = length / divisions
    
    # Initialize list for bridge components
    bridge = []
    
    # Create cylinders for the bridge
    for i in range(divisions):
        x = i * div_length
        base_point = Rhino.Geometry.Point3d(x, width/2, 0)
        
        # Create cylinder
        base_circle = Rhino.Geometry.Circle(base_point, pillar_radius)
        cylinder = Rhino.Geometry.Cylinder(base_circle, height)
        
        # Add cylinder to bridge
        bridge.append(cylinder.ToBrep(True, True))

        # If it's not the first or last division, create the beam between pillars
        if i > 0:
            start_point = Rhino.Geometry.Point3d(x - div_length, width/2, height)
            end_point = Rhino.Geometry.Point3d(x, width/2, height)
            line = Rhino.Geometry.Line(start_point, end_point)

            # Calculate midpoint of the line
            midpoint = Rhino.Geometry.Point3d((start_point.X + end_point.X) / 2, (start_point.Y + end_point.Y) / 2, (start_point.Z + end_point.Z) / 2)

            beam = Rhino.Geometry.Cylinder(Rhino.Geometry.Circle(midpoint, beam_radius), line.Length)
            
            # Add beam to bridge
            bridge.append(beam.ToBrep(True, True))
    
    # Return bridge components
    return bridge

# Create a cylinder bridge
bridge = create_cylinder_bridge(length, width, height, divisions, pillar_radius, beam_radius)

# Output the bridge
a = bridge
# ---------- end create_cylinder_bridge ----------
create_box_bridge = GhPythonScript(
    length=number_slider,
    width=Slider(16.29, range=0..100),
    height=Slider(21.73, range=0..100),
    divisions=Slider(3, range=0..10))  # -> out, a; inputs divisions: Int32
# ---------- create_box_bridge: Python ----------
import Rhino
import math
import scriptcontext
import rhinoscriptsyntax as rs

def create_box_bridge(length, width, height, divisions):
    # Calculate division length
    div_length = length / divisions
    
    # Initialize list for bridge components
    bridge = []
    
    # Create boxes for the bridge
    for i in range(divisions):
        x = i * div_length
        box_base = Rhino.Geometry.Point3d(x, 0, 0)
        box_length = div_length
        box_width = width
        box_height = height
        
        # Create corners for box
        box_corners = [
            Rhino.Geometry.Point3d(box_base[0], box_base[1], box_base[2]),
            Rhino.Geometry.Point3d(box_base[0] + box_length, box_base[1], box_base[2]),
            Rhino.Geometry.Point3d(box_base[0] + box_length, box_base[1] + box_width, box_base[2]),
            Rhino.Geometry.Point3d(box_base[0], box_base[1] + box_width, box_base[2]),
            Rhino.Geometry.Point3d(box_base[0], box_base[1], box_base[2] + box_height),
            Rhino.Geometry.Point3d(box_base[0] + box_length, box_base[1], box_base[2] + box_height),
            Rhino.Geometry.Point3d(box_base[0] + box_length, box_base[1] + box_width, box_base[2] + box_height),
            Rhino.Geometry.Point3d(box_base[0], box_base[1] + box_width, box_base[2] + box_height),
        ]
        
        # Create box
        box = Rhino.Geometry.Brep.CreateFromBox(box_corners)
        
        # Add box to bridge
        bridge.append(box)
    
    # Return bridge components
    return bridge

# Create a box bridge
bridge = create_box_bridge(100, 10, 20, 10)

# Output the bridge
a = bridge
# ---------- end create_box_bridge ----------
geometry = Geometry(create_box_bridge.a)
geometry_2 = Geometry(create_cylinder_bridge.a)
